# Grasshopper definition main.ghx (Grasshopper 1.0.8)

xy = XYPlane(Origin=Point(0, 0, 0))
rad = Radians(Degrees=Slider(20, range=0..100))
rad_2 = Radians(Degrees=Slider(20, range=0..100))
X = UnitX(Factor=1)
Y = UnitY(Factor=1)

# ----
# Section along Edges[0]
# Edges along Plane.X and Plane.Y
# Section along Edges[1]
number_slider = Slider(20, range=0..100)
xy_2 = XYPlane(Origin=Point(0, 0, 0))
rad_3 = Radians(Degrees=number_slider)
rad_4 = Radians(Degrees=Slider(20, range=0..100))
X_2 = UnitX(Factor=1)
Y_2 = UnitY(Factor=1)
rot3d = Rotate3D(Geometry=xy_2, Angle=<missing>, Center=Point(0, 0, 0), Axis=<missing>)  # -> Geometry, Transform
rot3d_2 = Rotate3D(Geometry=rot3d.Geometry, Angle=<missing>, Center=Point(0, 0, 0), Axis=<missing>)  # -> Geometry, Transform
relay = Relay(<missing>)
geo = Geometry(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)
number_slider_2 = Slider(0.95, range=0..1)
bbox = BoundingBox(Content=geo, Plane=<missing>)  # -> Box, Box_2
volume = Volume(Geometry=bbox.Box)  # -> Volume, Centroid
scale = Scale(Geometry=bbox.Box, Center=<missing>, Factor=<missing>)  # -> Geometry, Transform
debrep = DeconstructBrep(Brep=scale.Geometry)  # -> Faces, Edges, Vertices
item = ListItem(List=debrep.Edges, Index=0, Wrap=True)  # -> Item, Item1
number_slider_3 = Slider(8, range=0..10)
deplane = DeconstructPlane(Plane=relay)  # -> Origin, XAxis, YAxis, ZAxis
pframes = PerpFrames(Curve=item.Item, Count=<missing>, Align=True)  # -> Frames, Parameters
pframes_2 = PerpFrames(Curve=item.Item1, Count=Slider(16, range=5..30), Align=True)  # -> Frames, Parameters
sec = BrepPlane(Brep=geo, Plane=pframes.Frames)  # -> Curves, Points
boundary = BoundarySurfaces(Edges=sec.Curves)  # -> simplify(Surfaces)
sec_2 = BrepPlane(Brep=geo, Plane=pframes_2.Frames)  # -> Curves, Points
boundary_2 = BoundarySurfaces(Edges=sec_2.Curves)  # -> simplify(Surfaces)
debrep_2 = DeconstructBrep(Brep=bbox.Box)  # -> Faces, Edges, Vertices
item_2 = ListItem(List=debrep_2.Edges, Index=<missing>, Wrap=True)
len = Length(Curve=item_2)
graft = GraftTree(Tree=pframes.Frames, IncludeEmptyLists=True, IncludeNullItems=True)  # -> simplify(Tree)
graft_2 = GraftTree(Tree=pframes_2.Frames, IncludeEmptyLists=True, IncludeNullItems=True)  # -> simplify(Tree)
graft_3 = GraftTree(Tree=boundary, IncludeEmptyLists=True, IncludeNullItems=True)
flatten = FlattenTree(Tree=boundary, Path="{0}")
graft_4 = GraftTree(Tree=boundary_2, IncludeEmptyLists=True, IncludeNullItems=True)
flatten_2 = FlattenTree(Tree=boundary_2, Path="{0}")
c_script = CSharpScript(x=graft, y=graft_3)  # -> out, a; inputs x: tree, y: tree
# ---------- c_script: C# ----------
// Grasshopper Script Instance
#region Usings
using System;
using System.Linq;
using System.Collections;
using System.Collections.Generic;
using System.Drawing;

using Rhino;
using Rhino.Geometry;

using Grasshopper;
using Grasshopper.Kernel;
using Grasshopper.Kernel.Data;
using Grasshopper.Kernel.Types;
#endregion

public class Script_Instance : GH_ScriptInstance
{
    #region Notes
    /* 
      Members:
        RhinoDoc RhinoDocument
        GH_Document GrasshopperDocument
        IGH_Component Component
        int Iteration

      Methods (Virtual & overridable):
        Print(string text)
        Print(string format, params object[] args)
        Reflect(object obj)
        Reflect(object obj, string method_name)
    */
    #endregion

    private void RunScript(DataTree<object> x, DataTree<object> y, ref object a)
    {
        var xMap = new Dictionary<int, object>();
        foreach (GH_Path p in x.Paths){
            var branch = x.Branch(p);
            if (branch.Count > 0){
                xMap[p.Indices[0]] = branch[0];
            }
        }

        var result = new DataTree<object>();
        foreach (GH_Path p in y.Paths){
            int n = p.Indices[0];
            if (xMap.TryGetValue(n, out object item)){
                result.Add(item, p);
            }
        }

        a = result;
    }
}
# ---------- end c_script ----------
c_script_2 = CSharpScript(x=graft_2, y=graft_4)  # -> out, a; inputs x: tree, y: tree; same code as c_script
material_thickness = Slider(3.1, range=0..10)
bbx = BrepBrep(BrepA=graft_4, BrepB=flatten)  # -> Curves, Points
pshift = ShiftPaths(Data=bbx.Curves, Offset=-1)
midpt = CurveMiddle(Curve=pshift)
bbx_2 = BrepBrep(BrepA=graft_3, BrepB=flatten_2)  # -> Curves, Points
pshift_2 = ShiftPaths(Data=bbx_2.Curves, Offset=-1)
midpt_2 = CurveMiddle(Curve=pshift_2)
line = LineSDL(Start=<missing>, Direction=expr("-x", deplane.ZAxis), Length=len)
line_2 = LineSDL(Start=<missing>, Direction=deplane.ZAxis, Length=<missing>)
deplane_2 = DeconstructPlane(Plane=rot3d_2.Geometry)  # -> Origin, XAxis, YAxis, ZAxis
deplane_3 = DeconstructPlane(Plane=rot3d_2.Geometry)  # -> Origin, XAxis, YAxis, ZAxis
pipe = Pipe(Curve=line, Radius=expr("x/2", material_thickness), Caps=1, FitRail=False)
pipe_2 = Pipe(Curve=line_2, Radius=expr("x/2", <missing>), Caps=1, FitRail=False)
pshift_3 = ShiftPaths(Data=pipe, Offset=-1)
pshift_4 = ShiftPaths(Data=pipe_2, Offset=-1)
sec_3 = BrepPlane(Brep=<missing>, Plane=<missing>)  # -> Curves, Points
pshift_5 = ShiftPaths(Data=sec_3.Curves, Offset=-1)
rdiff = RegionDifference(CurvesA=graft_4, CurvesB=pshift_5)
area = Area(Geometry=rdiff)  # -> Area, Centroid
pl = ConstructPlane(Origin=area.Centroid, XAxis=deplane_2.ZAxis, YAxis=deplane_2.XAxis)
sec_4 = BrepPlane(Brep=<missing>, Plane=c_script.a)  # -> Curves, Points
pshift_6 = ShiftPaths(Data=sec_4.Curves, Offset=-1)
rdiff_2 = RegionDifference(CurvesA=graft_3, CurvesB=pshift_6)
area_2 = Area(Geometry=rdiff_2)  # -> Area, Centroid
pl_2 = ConstructPlane(Origin=area_2.Centroid, XAxis=deplane_3.ZAxis, YAxis=deplane_3.YAxis)
tstat = TreeStatistics(Tree=pshift_5)  # -> Paths, Length, Count
tstat_2 = TreeStatistics(Tree=pshift_6)  # -> Paths, Length, Count
dpath = DeconstructPath(Branch=tstat_2.Paths)
lng = ListLength(List=tstat.Paths)
dpath_2 = DeconstructPath(Branch=tstat.Paths)
lng_2 = ListLength(List=tstat_2.Paths)
number_slider_4 = Slider(416, range=0..1000)
number_slider_5 = Slider(200, range=0..1000)
number_slider_6 = Slider(200, range=0..1000)
item_3 = ListItem(List=dpath_2, Index=0, Wrap=True)  # -> Item, Item1
item_4 = ListItem(List=dpath, Index=0, Wrap=True)  # -> Item, Item1
panel = Panel("Y")
panel_2 = Panel("-")
number_slider_7 = Slider(44, range=0..100)
concat = Concatenate(FragmentA=<missing>, FragmentB=<missing>, FragmentC=<missing>, FragmentD=<missing>)
series = Series(Start=0, Step=<missing>, Count=<missing>)
pt = ConstructPoint(XCoordinate=series, YCoordinate=<missing>, ZCoordinate=0)
xy_3 = XYPlane(Origin=pt)
series_2 = Series(Start=0, Step=<missing>, Count=<missing>)
pt_2 = ConstructPoint(XCoordinate=series_2, YCoordinate=0, ZCoordinate=0)
xy_4 = XYPlane(Origin=pt_2)
panel_4 = Panel("SLF_RHN Architect")
number_slider_8 = Slider(9, range=0..100)
swatch = ColourSwatch(SwatchColor=RGB(0, 255, 51))
c_script_3 = CSharpScript(
    frame=graft(<missing>),
    fontName=<missing>,
    textHeight=Slider(7, range=0..100),
    spacing=Slider(0, range=0..100),
    horizontalAlignment=Slider(2, range=1..3),
    verticalAlignment=Slider(2, range=1..3),
    bold=Toggle(False),
    singleStrokeFont=Toggle(False))  # -> out, a, b; inputs textLine: String, frame: Plane, fontName: String, textHeight: Double, spacing: Double, horizontalAlignment: Int32, verticalAlignment: Int32, bold: Boolean, singleStrokeFont: Boolean
# ---------- c_script_3: C# ----------
// Grasshopper Script Instance
#region Usings
using System;
using System.Linq;
using System.Collections;
using System.Collections.Generic;


using Rhino;
using Rhino.Geometry;
using Rhino.DocObjects;

using Grasshopper;
using Grasshopper.Kernel;
using Grasshopper.Kernel.Data;
using Grasshopper.Kernel.Types;
#endregion

public class Script_Instance : GH_ScriptInstance
{
    #region Notes
    /* 
      Members:
        RhinoDoc RhinoDocument
        GH_Document GrasshopperDocument
        IGH_Component Component
        int Iteration

      Methods (Virtual & overridable):
        Print(string text)
        Print(string format, params object[] args)
        Reflect(object obj)
        Reflect(object obj, string method_name)
    */
    #endregion

    private void RunScript(
		string textLine,
		Plane frame,
		string fontName,
		double textHeight,
		double spacing,
		int horizontalAlignment,
		int verticalAlignment,
		bool bold,
		bool singleStrokeFont,
		ref object a,
		ref object b)
    {
        DimensionStyle dimStyle = new DimensionStyle();
        Font thisFont = new Font(fontName);
        if(bold){
        thisFont = new Font(fontName, Font.FontWeight.Bold, Font.FontStyle.Upright, false, false);
        }
        else{
        thisFont = new Font(fontName, Font.FontWeight.Normal, Font.FontStyle.Upright, false, false);
        }
        dimStyle.Font = thisFont;
        dimStyle.TextHeight = textHeight;
        int halign = horizontalAlignment;
        int valign = verticalAlignment;

        switch(halign){
        case 1:
            dimStyle.TextHorizontalAlignment = TextHorizontalAlignment.Left;
            break;
        case 2:
            dimStyle.TextHorizontalAlignment = TextHorizontalAlignment.Center;
            break;
        case 3:
            dimStyle.TextHorizontalAlignment = TextHorizontalAlignment.Right;
            break;
        default:
            dimStyle.TextHorizontalAlignment = TextHorizontalAlignment.Center;
            break;
        }
        switch(valign){
        case 1:
            dimStyle.TextVerticalAlignment = TextVerticalAlignment.Bottom;
            break;
        case 2:
            dimStyle.TextVerticalAlignment = TextVerticalAlignment.Middle;
            break;
        case 3:
            dimStyle.TextVerticalAlignment = TextVerticalAlignment.Top;
            break;
        default:
            dimStyle.TextVerticalAlignment = TextVerticalAlignment.Middle;
            break;
        }


        TextEntity tEntity = Rhino.Geometry.TextEntity.Create(textLine, frame, dimStyle, false, textHeight, 0);
        Brep[] srf = tEntity.CreateSurfaces(dimStyle, 0, spacing);
        Curve[] crv = tEntity.CreateCurves(dimStyle, singleStrokeFont, 0, spacing);
        a = srf;
        b = crv;
    }
}
# ---------- end c_script_3 ----------
c_script_4 = CSharpScript(
    textLine=<missing>,
    frame=graft(<missing>),
    fontName=<missing>,
    textHeight=Slider(7, range=0..100),
    spacing=Slider(0, range=0..100),
    horizontalAlignment=Slider(2, range=1..3),
    verticalAlignment=Slider(2, range=1..3),
    bold=Toggle(False),
    singleStrokeFont=Toggle(False))  # -> out, a, b; inputs textLine: String, frame: Plane, fontName: String, textHeight: Double, spacing: Double, horizontalAlignment: Int32, verticalAlignment: Int32, bold: Boolean, singleStrokeFont: Boolean; same code as c_script_3
tag = TextTag3D(Location=pl, Text=concat, Size=<missing>, Colour=<missing>, Justification=7)
orient = Orient(Geometry=rdiff, Source=pl, Target=graft(<missing>))  # -> Geometry, Transform
orient_2 = Orient(Geometry=rdiff_2, Source=pl_2, Target=graft(<missing>))  # -> Geometry, Transform
move = Move(Geometry=orient_2.Geometry, Motion=Vector(0, 0, 10))  # -> Geometry, Transform
replace = ReplacePaths(Data=c_script_4.b, Search=<missing>, Replace=tstat.Paths)
group = Group(Geometry=<missing>)
tstat_3 = TreeStatistics(Tree=c_script_4.b)  # -> Paths, Length, Count
replace_2 = ReplacePaths(Search=<missing>, Replace=tstat_2.Paths)
group_2 = Group(Geometry=<missing>)
tstat_4 = TreeStatistics()  # -> Paths, Length, Count

rot3d_3 = Rotate3D(Geometry=xy, Angle=rad, Center=Point(0, 0, 0), Axis=X)  # -> Geometry, Transform
rot3d_4 = Rotate3D(Geometry=rot3d_3.Geometry, Angle=rad_2, Center=Point(0, 0, 0), Axis=Y)  # -> Geometry, Transform
geo_2 = Geometry(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)
bbox_2 = BoundingBox(Content=geo_2, Plane=rot3d_4.Geometry)  # -> Box, Box_2
volume_2 = Volume(Geometry=bbox_2.Box)  # -> Volume, Centroid
number_slider_9 = Slider(16, range=5..30)
scale_2 = Scale(Geometry=bbox_2.Box, Center=volume_2.Centroid, Factor=Slider(0.95, range=0..1))  # -> Geometry, Transform
debrep_3 = DeconstructBrep(Brep=scale_2.Geometry)  # -> Faces, Edges, Vertices
# Edges along Plane.X and Plane.Y
item_5 = ListItem(List=debrep_3.Edges, Index=0, Wrap=True)  # -> Item, Item1
deplane_4 = DeconstructPlane(Plane=rot3d_4.Geometry)  # -> Origin, XAxis, YAxis, ZAxis
pframes_3 = PerpFrames(Curve=item_5.Item, Count=number_slider_9, Align=True)  # -> Frames, Parameters
pframes_4 = PerpFrames(Curve=item_5.Item1, Count=number_slider_9, Align=True)  # -> Frames, Parameters
sec_5 = BrepPlane(Brep=geo_2, Plane=pframes_3.Frames)  # -> Curves, Points
# Section along Edges[0]
boundary_3 = BoundarySurfaces(Edges=sec_5.Curves)  # -> simplify(Surfaces)
sec_6 = BrepPlane(Brep=geo_2, Plane=pframes_4.Frames)  # -> Curves, Points
# Section along Edges[1]
boundary_4 = BoundarySurfaces(Edges=sec_6.Curves)  # -> simplify(Surfaces)
debrep_4 = DeconstructBrep(Brep=bbox_2.Box)  # -> Faces, Edges, Vertices
item_6 = ListItem(List=debrep_4.Edges, Index=Slider(8, range=0..10), Wrap=True)
len_2 = Length(Curve=item_6)
graft_5 = GraftTree(Tree=pframes_3.Frames, IncludeEmptyLists=True, IncludeNullItems=True)  # -> simplify(Tree)
graft_6 = GraftTree(Tree=pframes_4.Frames, IncludeEmptyLists=True, IncludeNullItems=True)  # -> simplify(Tree)
graft_7 = GraftTree(Tree=boundary_3, IncludeEmptyLists=True, IncludeNullItems=True)
flatten_3 = FlattenTree(Tree=boundary_3, Path="{0}")
graft_8 = GraftTree(Tree=boundary_4, IncludeEmptyLists=True, IncludeNullItems=True)
flatten_4 = FlattenTree(Tree=boundary_4, Path="{0}")
c_script_5 = CSharpScript(x=graft_5, y=graft_7)  # -> out, a; inputs x: tree, y: tree; same code as c_script
c_script_6 = CSharpScript(x=graft_6, y=graft_8)  # -> out, a; inputs x: tree, y: tree; same code as c_script
material_thickness_2 = Slider(3.1, range=0..10)
bbx_3 = BrepBrep(BrepA=graft_8, BrepB=flatten_3)  # -> Curves, Points
pshift_7 = ShiftPaths(Data=bbx_3.Curves, Offset=-1)
midpt_3 = CurveMiddle(Curve=pshift_7)
bbx_4 = BrepBrep(BrepA=graft_7, BrepB=flatten_4)  # -> Curves, Points
pshift_8 = ShiftPaths(Data=bbx_4.Curves, Offset=-1)
midpt_4 = CurveMiddle(Curve=pshift_8)
line_3 = LineSDL(Start=midpt_3, Direction=expr("-x", deplane_4.ZAxis), Length=len_2)
line_4 = LineSDL(Start=midpt_4, Direction=deplane_4.ZAxis, Length=len_2)
deplane_5 = DeconstructPlane(Plane=rot3d_4.Geometry)  # -> Origin, XAxis, YAxis, ZAxis
deplane_6 = DeconstructPlane(Plane=rot3d_4.Geometry)  # -> Origin, XAxis, YAxis, ZAxis
pipe_3 = Pipe(Curve=line_3, Radius=expr("x/2", material_thickness_2), Caps=1, FitRail=False)
pipe_4 = Pipe(Curve=line_4, Radius=expr("x/2", material_thickness_2), Caps=1, FitRail=False)
pshift_9 = ShiftPaths(Data=pipe_3, Offset=-1)
pshift_10 = ShiftPaths(Data=pipe_4, Offset=-1)
sec_7 = BrepPlane(Brep=pshift_9, Plane=c_script_6.a)  # -> Curves, Points
pshift_11 = ShiftPaths(Data=sec_7.Curves, Offset=-1)
rdiff_3 = RegionDifference(CurvesA=graft_8, CurvesB=pshift_11)
area_3 = Area(Geometry=rdiff_3)  # -> Area, Centroid
pl_3 = ConstructPlane(Origin=area_3.Centroid, XAxis=deplane_5.ZAxis, YAxis=deplane_5.XAxis)
sec_8 = BrepPlane(Brep=pshift_10, Plane=c_script_5.a)  # -> Curves, Points
pshift_12 = ShiftPaths(Data=sec_8.Curves, Offset=-1)
rdiff_4 = RegionDifference(CurvesA=graft_7, CurvesB=pshift_12)
area_4 = Area(Geometry=rdiff_4)  # -> Area, Centroid
pl_4 = ConstructPlane(Origin=area_4.Centroid, XAxis=deplane_6.ZAxis, YAxis=deplane_6.YAxis)
tstat_5 = TreeStatistics(Tree=pshift_11)  # -> Paths, Length, Count
tstat_6 = TreeStatistics(Tree=pshift_12)  # -> Paths, Length, Count
dpath_3 = DeconstructPath(Branch=tstat_6.Paths)
lng_3 = ListLength(List=tstat_5.Paths)
dpath_4 = DeconstructPath(Branch=tstat_5.Paths)
lng_4 = ListLength(List=tstat_6.Paths)
item_7 = ListItem(List=dpath_4, Index=0, Wrap=True)  # -> Item, Item1
item_8 = ListItem(List=dpath_3, Index=0, Wrap=True)  # -> Item, Item1
number_slider_10 = Slider(44, range=0..100)
concat_2 = Concatenate(FragmentA="Y", FragmentB=item_7.Item, FragmentC="-", FragmentD=item_7.Item1)
series_3 = Series(Start=0, Step=Slider(200, range=0..1000), Count=lng_3)
pt_3 = ConstructPoint(XCoordinate=series_3, YCoordinate=Slider(416, range=0..1000), ZCoordinate=0)
xy_5 = XYPlane(Origin=pt_3)
series_4 = Series(Start=0, Step=Slider(200, range=0..1000), Count=lng_4)
pt_4 = ConstructPoint(XCoordinate=series_4, YCoordinate=0, ZCoordinate=0)
xy_6 = XYPlane(Origin=pt_4)
c_script_7 = CSharpScript(
    frame=graft(xy_6),
    fontName="SLF_RHN Architect",
    textHeight=Slider(7, range=0..100),
    spacing=Slider(0, range=0..100),
    horizontalAlignment=Slider(2, range=1..3),
    verticalAlignment=Slider(2, range=1..3),
    bold=Toggle(False),
    singleStrokeFont=Toggle(False))  # -> out, a, b; inputs textLine: String, frame: Plane, fontName: String, textHeight: Double, spacing: Double, horizontalAlignment: Int32, verticalAlignment: Int32, bold: Boolean, singleStrokeFont: Boolean; same code as c_script_3
c_script_8 = CSharpScript(
    textLine=concat_2,
    frame=graft(xy_5),
    fontName="SLF_RHN Architect",
    textHeight=Slider(7, range=0..100),
    spacing=Slider(0, range=0..100),
    horizontalAlignment=Slider(2, range=1..3),
    verticalAlignment=Slider(2, range=1..3),
    bold=Toggle(False),
    singleStrokeFont=Toggle(False))  # -> out, a, b; inputs textLine: String, frame: Plane, fontName: String, textHeight: Double, spacing: Double, horizontalAlignment: Int32, verticalAlignment: Int32, bold: Boolean, singleStrokeFont: Boolean; same code as c_script_3
tag_2 = TextTag3D(
    Location=pl_3,
    Text=concat_2,
    Size=Slider(9, range=0..100),
    Colour=ColourSwatch(SwatchColor=RGB(0, 255, 51)),
    Justification=7)
orient_3 = Orient(Geometry=rdiff_3, Source=pl_3, Target=graft(xy_5))  # -> Geometry, Transform
orient_4 = Orient(Geometry=rdiff_4, Source=pl_4, Target=graft(xy_6))  # -> Geometry, Transform
move_2 = Move(Geometry=orient_4.Geometry, Motion=Vector(0, 0, 10))  # -> Geometry, Transform
tstat_7 = TreeStatistics(Tree=c_script_8.b)  # -> Paths, Length, Count
replace_3 = ReplacePaths(Data=c_script_8.b, Search=tstat_7.Paths, Replace=tstat_5.Paths)
group_3 = Group(Geometry=replace_3)
tstat_8 = TreeStatistics()  # -> Paths, Length, Count
replace_4 = ReplacePaths(Search=tstat_8.Paths, Replace=tstat_6.Paths)
group_4 = Group(Geometry=replace_4)
